# Grasshopper definition GH-GPT.gh (Grasshopper 1.0.7)

send_to_gpt = BooleanToggle(False)
send_to_gpt_2 = BooleanToggle(False)
c_script = CSharpScript(
    sendQuestion=send_to_gpt,
    apiKey="Your API key here",
    prompt="hello!",
    Reference=["C:\USERS\ADMINISTRATOR\DESKTOP\MOCKINGBIRD\Newtonsoft.Json.dll", "C:\USERS\ADMINISTRATOR\DESKTOP\MOCKINGBIRD\System.Net.Http.dll"])  # -> out, A; inputs sendQuestion: Boolean, apiKey: String, prompt: String
# ---------- c_script: C# usings ----------
using Grasshopper.Kernel.Special;
using Grasshopper.Kernel.Parameters;
using System.Net.Http;
using System.Text;
using System.Threading.Tasks;
using Newtonsoft.Json;
using System.Xml.Linq;
using System.ComponentModel;
# ---------- c_script: C# ----------
    if (sendQuestion)
    {
      string messageContent = "hello";
      double temperature = 0.7;
      A = PostToGPT3(apiKey, messageContent, temperature);
    }
    else
    {
      A = "waiting to post";
    }
# ---------- c_script: C# additional code ----------
  // By Andycamos 2023/06/26
  // https://github.com/andycamos

  // Post Struct
  public class MessageGo
  {
    public string role { get; set; }
    public string content { get; set; }
  }

  public class OpenAIChatRequest
  {
    public string model { get; set; }
    public List<MessageGo> messages { get; set; }
    public double temperature { get; set; }
  }

  // Receive Struct
  public class Message
  {
    public string role { get; set; }
    public string content { get; set; }
  }

  public class Choice
  {
    public int index { get; set; }
    public Message message { get; set; }
    public string finish_reason { get; set; }
  }

  public class OpenAIChatResponse
  {
    public string id { get; set; }
    public string object_name { get; set; }
    public int created { get; set; }
    public string model { get; set; }
    public List<Choice> choices { get; set; }
  }

  private static readonly HttpClient client = new HttpClient();
  public string PostToGPT3(string apiKey, string messageContent, double temperature)
  {
    var requestObject = new OpenAIChatRequest
      {
        model = "gpt-3.5-turbo",
        messages = new List<MessageGo>
        {
          new MessageGo { role = "user", content = messageContent }
          },
        temperature = temperature
        };

    string jsonString = JsonConvert.SerializeObject(requestObject);

    var httpContent = new StringContent(jsonString, Encoding.UTF8, "application/json");

    client.DefaultRequestHeaders.Remove("Authorization");
    client.DefaultRequestHeaders.Add("Authorization", "Bearer " + apiKey);

    var response = client.PostAsync("https://api.openai.com/v1/chat/completions", httpContent).Result;

    if (response.IsSuccessStatusCode)
    {
      var responseContent = response.Content.ReadAsStringAsync().Result;

      OpenAIChatResponse responseObject = JsonConvert.DeserializeObject<OpenAIChatResponse>(responseContent);

      if (responseObject.choices.Count > 0)
      {
        return responseObject.choices[0].message.content;
      }
      else
      {
        return "No response from assistant";
      }
    }
    else
    {
      return string.Format("Request failed with status code: {0}", response.StatusCode);
    }
  }
# ---------- end c_script ----------
python = GhPythonScript(sendQuestion=send_to_gpt_2, apiKey="Your API key here", prompt="hello!")  # -> out, a; inputs sendQuestion: Boolean
# ---------- python: Python ----------
#  By Andycamos 2023/06/26
#  https://github.com/andycamos


import clr
clr.AddReference('System.Web.Extensions')
from System.Web.Script.Serialization import JavaScriptSerializer
from System.Net import * 
from System import Convert
from System.Text import Encoding
import urllib # - this needs Python 2.7.7 or later!


if sendQuestion:
    ServicePointManager.SecurityProtocol = SecurityProtocolType.Tls12; #TLS 1.2
    
    # Create a web client
    client = WebClient()
    
    # OpenAI API Key
    api_key = apiKey
    
    temperature = 0.7
    
    # Set up headers
    client.Headers[HttpRequestHeader.Authorization] = "Bearer " + api_key
    client.Headers[HttpRequestHeader.ContentType] = "application/json"
    
    # Data to send
    data_dict = {
        "model": "gpt-3.5-turbo",
        "messages": [
            {
                "role": "user",
                "content": prompt
            }
        ],
        "temperature": temperature,
    }
    serializer = JavaScriptSerializer()
    data = serializer.Serialize(data_dict)
    
    # Request URL
    address = "https://api.openai.com/v1/chat/completions"
    
    # Send request and print response
    response = client.UploadString(address, data)
    
    # Try to parse the response
    try:
        # Deserialize the response
        response_dict = serializer.DeserializeObject(response)
    
        # Get the content from the response
        a = response_dict["choices"][0]["message"]["content"]

    except KeyError:
        # Handle missing key in the response
        print("Error: The response from the OpenAI API is missing some expected keys.")
    except IndexError:
        # Handle missing index in the response
        print("Error: The response from the OpenAI API does not contain any choices.")
    except Exception as e:
        # Handle any other exceptions
        print("An error occurred: "+str(e))
else:
    a = 'waiting to post'
# ---------- end python ----------
panel = Panel(python.a)
panel_2 = Panel(c_script.A)
